# Dynamo graph Changing Element's Subcategory.dyn (Dynamo 2.0.1.5055)

categories = Categories(index=228)
all_elements_of_category = ElementsOfCategory(Category=categories)
subcategories = Custom[Category.Subcategories](category=categories)  # Retrieves all the subcategories for a given category
code_block = CodeBlock { 0; }
getItemAtIndex = List.GetItemAtIndex(list=subcategories, index=code_block)
boolean = BoolSelector(false)
setSubCategory = Custom[Element.SetSubCategory](elements=all_elements_of_category, subCategory=getItemAtIndex, cutOrProjection=boolean)  # Assigns the given element(s) to the specified subcategory. The node should work for all geometry and curve elements. In some cases the GraphicsStyleType (Cut = TRUE, Projection = FALSE) needs to be specified.
watch = Watch(setSubCategory.success)
watch_2 = Watch(setSubCategory.elements)
