# Dynamo graph Close Gaps.dyn (Dynamo 2.0.2.6826)

code_block = CodeBlock { "FRAME"; }
select_model_lines_by_style = Custom[Select Model Lines by Style](Style_Name=code_block)  # This node will select all model lines in the revit project by a line style name.
geometry = Element.Geometry(element=select_model_lines_by_style)
watch = Watch(geometry)
getLocation = Element.GetLocation(element=select_model_lines_by_style)
code_block_2 = CodeBlock { 0.0026; }
groupByDistance = Custom[Springs.Geometry.GroupByDistance](geometry=getLocation, margin=code_block_2)  # Splits the list of geometry elements into groups if the distance between them is less than the provided margin.
code_block_3 = CodeBlock { 0.08; }
merge = Custom[Springs.LineLoop.Merge](lines=groupByDistance, margin=code_block_3)  # Attempts to join lines into a single chain of joined curves. The node returns the new lines as a chain and with the original order. The success outputs returns the success of the execution as a true/false boolean.
number_slider = DoubleSlider(0.3, range=0..100 step 0.1)
translate = Geometry.Translate(geometry=merge.lines, yTranslation=number_slider)
watch_2 = Watch(groupByDistance)
watch_3 = Watch(select_model_lines_by_style)
get_line_style_by_name = Custom[Get Line Style by Name](Name=code_block)  # This node will return a line style object by its name. Line styles can be either Drafting or Model Line Property.
watch_4 = Watch(get_line_style_by_name)
