# Dynamo graph Lines with gap to polycurve.dyn (Dynamo 2.0.2.6826)

code_block = CodeBlock { "Lines"; }
get_line_style_by_name = Custom[Get Line Style by Name](Name=code_block)  # This node will return a line style object by its name. Line styles can be either Drafting or Model Line Property.
select_model_lines_by_style = Custom[Select Model Lines by Style](Style_Name=code_block)  # This node will select all model lines in the revit project by a line style name.
geometry = Element.Geometry(element=select_model_lines_by_style)
flatten = List.Flatten(list=geometry)
number_slider = DoubleSlider(1, range=0..100 step 0.1)
byJoinedCurves = PolyCurve.ByJoinedCurves(curves=flatten, joinTolerance=number_slider)
watch = Watch(byJoinedCurves)
watch_2 = Watch(geometry)
watch_3 = Watch(flatten)
number_slider_2 = DoubleSlider(2, range=0..100 step 0.1)
translate = Geometry.Translate(geometry=byJoinedCurves, xTranslation=number_slider_2)
curves = PolyCurve.Curves(polyCurve=byJoinedCurves)
