# Dynamo graph TagMaterials.dyn (Dynamo 0.8.2.2392)

categories = Categories("GenericModel")
# note: This is the depth at which
# elements will be tagged.
# Try to keep it to a realistic
# view depth. Can act as a
# Refresh switch too.
# note: In our particular case all elements are
# modeled as Generic Models
view_depth_cut_off_distance_feet = DoubleSlider(2.181, range=0.001..11 step 0.01)
material_tag_type = FamilyTypes("Material Tag 1:Right")
material_tag_type_2 = FamilyTypes("Material Tag 1:Left")
# note: After running the graphfor the first time, Dynamo can't guess when you've made any changes inside Revit. Toggle the "Refresh" bool once to notify Dynamo of any changes. This may include but is not limited to:
#    - changing the active view
#    - editing the view crop box
#    - editing the view scale
refresh = BoolSelector(false)
# note: Please have only one
# instance of Revit open
# during execution.
create_new_tags = BoolSelector(true)
pandora_s_box = Python(IN[0]=categories, IN[1]=view_depth_cut_off_distance_feet, IN[2]=material_tag_type, IN[3]=material_tag_type_2, IN[4]=refresh, IN[5]=create_new_tags)
# ---------- pandora_s_box.python (174 lines) ----------
import clr
from math import floor

clr.AddReference("RevitServices")
from RevitServices.Persistence import DocumentManager
from RevitServices.Transactions import TransactionManager
doc = DocumentManager.Instance.CurrentDBDocument
uidoc = DocumentManager.Instance.CurrentUIApplication.ActiveUIDocument

clr.AddReference("RevitAPI")
from  Autodesk.Revit.DB import *

clr.AddReference("RevitNodes")
import Revit
clr.ImportExtensions(Revit.Elements)
clr.ImportExtensions(Revit.GeometryConversion)

clr.AddReference('ProtoGeometry')
from Autodesk.DesignScript.Geometry import *

clr.AddReference("System")
import System
from System.Collections.Generic import List
PF_path = System.Environment.GetFolderPath(System.Environment.SpecialFolder.ProgramFilesX86)
Lib_path = '\IronPython 2.7\Lib'
import sys
sys.path.append("%s%s" % (PF_path, Lib_path))
import ctypes
import time

SetForegroundWindow = ctypes.windll.user32.SetForegroundWindow
SendKeys = ctypes.windll.user32.keybd_event

def UP1():
	SendKeys(0x26, 0, 0, 0)
	SendKeys(0x26, 0, 0x0002, 0)
def DN1():
	SendKeys(0x28, 0, 0, 0)
	SendKeys(0x28, 0, 0x0002, 0)

Cat1 = UnwrapElement(IN[0])
cutoff1 = IN[1]
IfcTag = UnwrapElement(IN[2])
IfcTag_L = UnwrapElement(IN[3])
boolean = IN[5]

#get active view's data
view = doc.ActiveView
view_or = view.Origin.ToPoint()
view_nr = view.ViewDirection.ToVector()
view_pl = Plane.ByOriginNormal(view_or,view_nr)
vscale = view.Scale
viewR = view.RightDirection.ToVector()
#temporarily modify the view's clip depth
TransactionManager.Instance.EnsureInTransaction(doc)
fco = view.LookupParameter("Far Clip Offset")
subT = SubTransaction(doc)
subT.Start()
parset1 = fco.Set(cutoff1)
doc.Regenerate()
#extract only the visible elements
fec1 = FilteredElementCollector(doc, view.Id).OfCategoryId(Cat1.Id).ToElements()
VisibleEl = [e.ToDSType(True) for e in fec1]
subT.RollBack()
TransactionManager.Instance.TransactionTaskDone()
#get the crop region and shrink appropriately to the tagscale
crop1 = view.GetCropRegionShapeManager().GetCropRegionShape()
crop_pl = crop1.GetPlane()
viewdims = crop1.GetRectangularHeight(crop_pl) 
viewdims1 = crop1.GetRectangularWidth(crop_pl)
dynpts = [c.GetEndPoint(0).ToPoint() for c in crop1]
crop_perimeter = Rectangle.ByCornerPoints(dynpts)
v1 = Vector.ByTwoPoints(dynpts[0], dynpts[3]).Normalized().Scale(viewdims *0.1) #10% buffer
v2 = Vector.ByTwoPoints(dynpts[0], dynpts[1]).Normalized().Scale(viewdims1 *0.1)
dynpts[0] = dynpts[0].Add(v1.Reverse()).Add(v2)
dynpts[1] = dynpts[1].Add(v1.Reverse()).Add(v2.Reverse())
dynpts[2] = dynpts[2].Add(v1).Add(v2.Reverse())
dynpts[3] = dynpts[3].Add(v1).Add(v2)
dyncrop = Rectangle.ByCornerPoints(dynpts)
#get an accurate element location point in the view
cbox = view.CropBox
boxmin =cbox.Min.ToPoint()
boxmax = cbox.Max.ToPoint()
viewbox = Cuboid.ByCorners(boxmin, boxmax)
tf1 = cbox.Transform
cs1 = CoordinateSystem.ByOriginVectors(tf1.Origin.ToPoint(),tf1.BasisX.ToVector(),tf1.BasisY.ToVector(), tf1.BasisZ.ToVector())
viewbox = viewbox.Transform(cs1)
#elements that fail at any step, will be popped out of the list; xrange + pop is convoluted but faster to execute
ElLoc1 = []
for i in xrange(len(VisibleEl)-1,-1,-1):
	try:
		s1 = viewbox.Intersect(VisibleEl[i].Geometry()[0])[0]
		pl1 = Plane.ByOriginNormal(s1.Centroid(), view_nr)
		sf1 = s1.Intersect(pl1)[0]
		p1 = sf1.PointAtParameter(0,0)
		p2 = sf1.PointAtParameter(1,1)
		l1 = Line.ByStartPointEndPoint(p1,p2)
		cl1 = sf1.Intersect(l1)
		if len(cl1) <= 1:
			p1 = sf1.PointAtParameter(0,1)
			p2 = sf1.PointAtParameter(1,0)
			l1 = Line.ByStartPointEndPoint(p1,p2)
			cl1 = sf1.Intersect(l1)
		cl_pt = min(cl1, key = dyncrop.DistanceTo).PointAtParameter(0.5)
		ElLoc1.append(view_pl.ClosestPointTo(cl_pt))
		to_disp = [cl_pt,l1,p1,p2,sf1,pl1,s1]
		[x.Dispose() for x in to_disp]
		[x.Dispose() for x in cl1]
	except: VisibleEl.pop(i) ; pass
ElLoc1.reverse()
#helper function for sorting
def sortElements(l1): return l1[1].Z
VisibleEl2 = [[a,b] for a,b in zip(VisibleEl, ElLoc1)]
VisibleEl3 = sorted(VisibleEl2, key = sortElements)
ElLoc3 = [e[1] for e in VisibleEl3]
VisibleEl3 = [e[0] for e in VisibleEl3]
#get the location points @ cropbox
def Avrg(l1): return sum(l1)/len(l1)
def PtAvrg(pts):
	xA = Avrg([p.X for p in pts])
	yA = Avrg([p.Y for p in pts])
	zA = Avrg([p.Z for p in pts])
	return Point.ByCoordinates(xA,yA,zA)
def TagPts1(pt1,ap1,box,v1,margin,pl1):
	isRight = True
	l1 = Line.ByStartPointDirectionLength(pt1,v1,margin)
	l2 = Line.ByStartPointDirectionLength(pt1,v1.Reverse(),margin)
	try:
		pt2a = box.Intersect(l1)[0]
		pt2b = box.Intersect(l2)[0]
		dist1 = pt1.DistanceTo(pt2a)
		dist2 = pt1.DistanceTo(pt2b)
		if dist1 > dist2: pt2 = pt2b; isRight = False
		else: pt2 = pt2a
	except: pt2 = pt1
	try: pt2.Z
	except: pt2 = pt2.PointAtParameter(0)
	return pt2, isRight
ap1 = PtAvrg(ElLoc3)
ElLoc4 = [TagPts1(pt1,ap1,crop_perimeter,viewR,viewdims,view_pl) for pt1 in ElLoc3]
isRight = [e[1] for e in ElLoc4]
ElLoc4 = [e[0] for e in ElLoc4]
ElementsToTag = UnwrapElement(VisibleEl3)
#create the tags
if boolean:
	#collect all existing tags in the view and the tagged elements
	ViewTags = FilteredElementCollector(doc).OfClass(IndependentTag).OwnedByView(view.Id).ToElements()
	TaggedElId = [t.TaggedLocalElementId for t in ViewTags]
	tags = []
	tagHead = [p.ToXyz(True) for p in ElLoc4]
	tagEnd = [p1.ToXyz(True) for p1 in ElLoc3]
	tm1 = TagMode.TM_ADDBY_MATERIAL
	to1 = TagOrientation.Horizontal
	TransactionManager.Instance.EnsureInTransaction(doc)
	for i, j, k, l in zip(ElementsToTag, tagHead, tagEnd, isRight):
		if i.Id not in TaggedElId:
			tag = doc.Create.NewTag(view, i, True , tm1, to1, j)
			if l: tag.ChangeTypeId(IfcTag.Id)
			else: tag.ChangeTypeId(IfcTag_L.Id)
			tag.LeaderEnd = k
			tag.TagHeadPosition = j
			tags.append(tag)
	tagsId = [t.Id for t in tags]
	tagsId2 = List[ElementId](tagsId)
	uidoc.Selection.SetElementIds(tagsId2)
	TransactionManager.Instance.TransactionTaskDone()
	rvt_proc = System.Diagnostics.Process.GetProcessesByName("Revit")
	rvt_winH = rvt_proc[0].MainWindowHandle
	active_win = SetForegroundWindow(rvt_winH)
	UP1()
	DN1()
	OUT = tags, tagHead, isRight
else:
	OUT = "Tag creation is disabled.\nPlease set to True"
# ----------------------------------------
watch = Watch(pandora_s_box)
code_block = CodeBlock()
# ---------- code_block.designscript (4 lines) ----------
//The workflow had to be split in two parts.
//Therefore you must run the graph twice.
//The initial run must be set to False
//and the secondary run must be set to True
# ----------------------------------------
code_block_2 = CodeBlock()
# ---------- code_block_2.designscript (5 lines) ----------
/* TO DO:
+ need to re-work the tag uncrossing algorithm (no uncrossing atm)
+ find a workaround for the tag size (so that we can merge the scripts)
+ further improve the tag distribution algorithm?
*/;
# ----------------------------------------
set_me = BoolSelector(true)
code_block_3 = CodeBlock(switch=set_me, input=pandora_s_box) { switch ? input : null; }
tag_alignment = Python(IN[0]=code_block_3)
# ---------- tag_alignment.python (54 lines) ----------
import clr

clr.AddReference("RevitServices")
from RevitServices.Persistence import DocumentManager
from RevitServices.Transactions import TransactionManager
doc = DocumentManager.Instance.CurrentDBDocument

clr.AddReference("RevitAPI")
from  Autodesk.Revit.DB import *

def ElSize(bb):
	min = bb.Min
	max = bb.Max
	corner = XYZ(max.X,max.Y,min.Z)
	len1 = min.DistanceTo(corner)
	h1 = max.DistanceTo(corner)
	return h1
def distTags(taglist):
	z1 = taglist[0][2].Z
	for i in xrange(len(taglist)):
		oldPt = taglist[i][2]
		if oldPt.Z < z1:
			newPt = XYZ(oldPt.X, oldPt.Y, z1)
			taglist[i][0].TagHeadPosition = newPt
		elif oldPt.Z >= z1:
			z1 = oldPt.Z
		if i + 1 < len(taglist): z1 += (taglist[i][1]*0.6 + taglist[i+1][1]*0.6)
	return None
def AddElbow(tag):
	head = tag[0].TagHeadPosition
	tag[0].LeaderElbow = head.Add(v1)
	
input1 = UnwrapElement(IN[0])
tags = input1[0]
tagHead = input1[1]
isRight = input1[2]

view = doc.ActiveView
bb1 = [t.get_BoundingBox(view) for t in tags]
elHeight = map(ElSize,bb1)
margin1 = min(elHeight)
v1 = view.RightDirection.Multiply(margin1)
Ltags, Rtags = [], []
for i in xrange(len(tags)):
	if isRight[i]:Rtags.append([tags[i],elHeight[i],tagHead[i]])
	else: Ltags.append([tags[i],elHeight[i],tagHead[i]])
TransactionManager.Instance.EnsureInTransaction(doc)
distTags(Ltags)
distTags(Rtags)
map(AddElbow,Ltags)
v1 = v1.Negate()
map(AddElbow,Rtags)
TransactionManager.Instance.TransactionTaskDone()
OUT = elHeight
# ----------------------------------------
